# Grasshopper definition make path.gh (Grasshopper 1.0.7)

position_offse = Slider(-155, range=-200..200)
curve = Curve([<curve referenced from the Rhino model> x24])
vector_xyz = VectorXYZ(XComponent=0, YComponent=position_offse, ZComponent=0)  # -> Vector, Length
move = Move(Geometry=curve, Motion=vector_xyz.Vector)  # -> Geometry, Transform
curve_join_inset_end = Slider(9, range=2..50)
curve_join_inset_start = Slider(9, range=2..50)
wall_piece_spacing = Slider(4, range=1..20)
material_thickness = Slider(3, range=1..10)
section = Slider(19, range=0..22)
number_slider = Slider(7, range=0..20)
special_insert_shape = BooleanToggle(True)
left_side = BooleanToggle(False)
tab_width = Slider(5, range=2..50)
make_tabs = BooleanToggle(True)
tab_height = Slider(6, range=3..50)
curve_join_inset = Slider(9, range=2..50)
preserve_length = Slider(11, range=2..50)
debug = BooleanToggle(False)
chain_length = Slider(3, range=1..10)
type = Slider(2, range=1..2)
parts_seperation = Slider(1.8, range=1..5)

# ---- group: Generate Tabs
explode = Explode(Curve=move.Geometry, Recursive=True)  # -> Segments, Vertices

# ----
simplify_tree = SimplifyTree(Tree=explode.Segments, Front=False)
flatten_tree = FlattenTree(Tree=simplify_tree, Path="{0}")

# ---- group: Generate Tabs (continued)
panel = Panel(simplify_tree)

# ----
curve_direction_helper = GhPythonScript(curves=flatten_tree)  # -> out, a; inputs curves: list of Curve
# ---------- curve_direction_helper: Python ----------
import Rhino.Geometry as rg

arrows = []

arrowSize = 3.0

for crv in curves:

    # midpoint parameter
    t = crv.Domain.Mid

    # midpoint
    pt = crv.PointAt(t)

    # tangent
    tan = crv.TangentAt(t)
    tan.Unitize()

    # arrow end
    endPt = pt + (tan * arrowSize)

    # main arrow shaft
    arrows.append(rg.Line(pt, endPt))

    # arrowhead
    perp = rg.Vector3d(-tan.Y, tan.X, 0)
    perp.Unitize()

    headBack = endPt - (tan * (arrowSize * 0.3))

    left = headBack + (perp * (arrowSize * 0.2))
    right = headBack - (perp * (arrowSize * 0.2))

    arrows.append(rg.Line(endPt, left))
    arrows.append(rg.Line(endPt, right))


a = arrows
# ---------- end curve_direction_helper ----------

# ---- group: Walls and Tabs
height = Slider(33, range=10..200)
make_cut_pattern = GhPythonScript(
    showdebug=debug,
    inputParts=simplify_tree,
    section=section,
    index=number_slider,
    height=height,
    tabs=make_tabs,
    depth=material_thickness,
    width=tab_width,
    side=left_side,
    wallPathSpace=wall_piece_spacing,
    tabHeight=tab_height,
    curveJoinInsetStart=curve_join_inset_start,
    curveJoinInsetEnd=curve_join_inset_end,
    special=special_insert_shape)  # -> out, horizontal, vertical, placedHoles, kerf_left, kerf_bottom, isCurve, debug; inputs showdebug: Boolean, inputParts: tree of Curve, section: Int32, index: Int32, tabs: Boolean, side: Boolean, wallPathSpace: Int32, tabHeight: Int32, special: Boolean
# ---------- make_cut_pattern: Python ----------
import Rhino.Geometry as rg
import math

#Select parts, and get state of it
section = int(section)
branch = inputParts.Branch(section)
#index = int(index) % len(branch)
index = int(index)
count = len(branch)
if not curveJoinInsetStart:
    curveJoinInsetStart = 10.0
if not curveJoinInsetEnd:
    curveJoinInsetEnd = 10.0

curve = branch[index % count]
prevCurve = branch[(index - 1) % count]
nextCurve = branch[(index + 1) % count]

prevIsLine = prevCurve.IsLinear()
nextIsLine = nextCurve.IsLinear()
invertPattern = ((index % count) % 2 == 0)

# vertical tab height
tabHeight = int(tabHeight)

#spacing for each piece of wall
wallPathSpace = int(wallPathSpace)

baseHoles = []

#output geom
horizontal = []
vertical = []
placedHoles = []

#debug geom
debug = []

joinedLoop = rg.Curve.JoinCurves(branch)[0]

orientation = joinedLoop.ClosedCurveOrientation(
    rg.Plane.WorldXY
)

inside = (
    orientation == rg.CurveOrientation.CounterClockwise
)

print(orientation)

def makeTabLine(x1,y1,x2,y2):
    return rg.Line(
        rg.Point3d(x1,y1,0),
        rg.Point3d(x2,y2,0)
    )

def makeVerticalTabs(xPos, thisTabHeight = tabHeight, left = False, invert=False, inside=False):
    sideLines = []

    usable = height
    vcount = int(round((usable - thisTabHeight ) / thisTabHeight / 2))

    if vcount < 1:
        return sideLines

    total = (vcount * thisTabHeight ) + ((vcount - 1) * thisTabHeight )
    voffset = (usable - total) / 2

    #set up direction 
    x1 = xPos + (depth * (-1 if left else 1) * (1 if invert else 0)) - (depth  * (-1 if left else 1) * (1 if inside else 0))
    x2 = x1 + (depth * (-1 if left else 1) * (-1 if invert else 1))
    
    #start line
    if inside:
        print("draw little connecting tab to smaller size")
    
    
    if x1 != xPos:
        sideLines.append(makeTabLine(x1, 0, x2, 0))
    sideLines.append(makeTabLine(x1, 0, x1, voffset))
    
    #do tabs
    for i in range(vcount):

        y1 = i * 2 * thisTabHeight  + voffset
        y2 = y1 + thisTabHeight 
        sideLines.append(makeTabLine(x1, y1, x2, y1))
        sideLines.append(makeTabLine(x2, y1, x2, y2))
        sideLines.append(makeTabLine(x2, y2, x1, y2))
        if i < vcount-1: 
            sideLines.append(makeTabLine(x1, y2, x1, y2+thisTabHeight ))

    #do end
    if x1 != xPos:
        sideLines.append(makeTabLine(x1, usable, x2, usable))
    sideLines.append(makeTabLine(x1, usable - voffset, x1, usable))

    return sideLines
    
def isLineBoundary(i):
    if not branch[i].IsLinear():
        return False

    nextI = (i + 1) % count
    return branch[nextI].IsLinear()
    
def findPrevBoundary(startIndex):
    i = (startIndex - 1) % count

    while i != startIndex:
        if isLineBoundary(i):
            return i
        i = (i - 1) % count

    return None


def findNextBoundary(startIndex):
    i = (startIndex + 1) % count

    while i != startIndex:
        if isLineBoundary(i):
            return i
        i = (i + 1) % count

    return None
    
def moveLines(lines, dx):
    moved = []

    xform = rg.Transform.Translation(dx, 0, 0)

    for ln in lines:
        copy = rg.Line(ln.From, ln.To)
        copy.Transform(xform)
        moved.append(copy)

    return moved
    
def cornerDirection(a, b):

    ta = a.TangentAt(a.Domain.Max)
    tb = b.TangentAt(b.Domain.Min)

    ta.Unitize()
    tb.Unitize()

    cross = rg.Vector3d.CrossProduct(ta, tb)

    return cross.Z

def debugCorner(a, b):

    ta = a.TangentAt(a.Domain.Max)
    tb = b.TangentAt(b.Domain.Min)

    ta.Unitize()
    tb.Unitize()

    pt = a.PointAtEnd

    scale = 5

    lineA = rg.Line(pt, pt + ta * scale)
    lineB = rg.Line(pt, pt + tb * scale)

    cross = rg.Vector3d.CrossProduct(ta, tb)

    dot = rg.TextDot(str(round(cross.Z, 3)), pt)

    return lineA, lineB, dot

def cornerAngle(a, b):

    ta = a.TangentAt(a.Domain.Max)
    tb = b.TangentAt(b.Domain.Min)

    ta.Unitize()
    tb.Unitize()

    angle = rg.Vector3d.VectorAngle(ta, tb)
    return math.degrees(angle)


def isSpecialCorner(a, b, tolerance = 2.0):

    angle = cornerAngle(a, b)

    # normalize reflex angles
    if angle > 180:
        angle = 360 - angle

    # treat near-0 and near-90 as safe
    isZero = abs(angle - 0) < tolerance
    isNinety = abs(angle - 90) < tolerance
    isStraight = abs(angle - 180) < tolerance

    return not (isZero or isNinety or isStraight)

def trimCurveByLength(crv, startDist, endDist):

    total = crv.GetLength()

    t0 = crv.Domain.Min
    t1 = crv.Domain.Max

    success0, startT = crv.LengthParameter(startDist)
    success1, endT = crv.LengthParameter(total - endDist)

    if not success0:
        startT = t0

    if not success1:
        endT = t1

    return crv.Trim(startT, endT)


# measure length of line, and make across X
length = curve.GetLength()
isCurve = not curve.IsLinear()

prevBoundary = findPrevBoundary(index)
nextBoundary = findNextBoundary(index)
leftAngle = cornerAngle(prevCurve, curve)
rightAngle = cornerAngle(curve, nextCurve)

print("Left angle:", leftAngle)
print("Right angle:", rightAngle)
specialLeft = isSpecialCorner(prevCurve,curve)
specialRight = isSpecialCorner(curve,nextCurve)

# figure out inner / concave or outer / convex angle 

insideCornerLeft = cornerDirection(prevCurve, curve) > 0
insideCornerRight = cornerDirection(curve, nextCurve) > 0
A,B,D = debugCorner(prevCurve, curve)
if showdebug:
    debug = []
    debug.append(A)
    debug.append(B)
    debug.append(D)
print("Left %s. Right %s." % (insideCornerLeft, insideCornerRight))

# figure out if we are a special corner or not
# could be curve, so let's figure out our curves inside or outside and do offset if needed


# special conditional for a sharp curve to curve intersection
startInset = curveJoinInsetStart if (specialLeft and special) else 0
endInset = curveJoinInsetEnd if (specialRight and special) else 0

# trim to correct for special intersections
trimmedCurve = trimCurveByLength(curve,startInset,endInset)
usableLength = trimmedCurve.GetLength()

if inside:
    print("Inside curve - length calculated from offset")
    offsets = trimmedCurve.Offset(    rg.Plane.WorldXY,    -depth,    0.01,    rg.CurveOffsetCornerStyle.Sharp )
    if showdebug:
        debug.append(offsets[0])
    usableLength = offsets[0].GetLength()


#updated to use recalculated length taking special corners into consideration
tabcount = int(round((usableLength - width) / width / 2))
# make tabs
# would be a list on tab 0 at 0, width, tab 1 at (1 * 2 width) + (1 * 2 width) + width 
totalWidth = (tabcount * width) + ((tabcount - 1) * width)
offset = (usableLength - totalWidth) / 2


if tabs and tabcount > 0 and not isCurve:
    # horizontal lines
    horizontal.append(rg.Line(rg.Point3d(startInset,height,0), rg.Point3d(startInset+usableLength, height,0)))

    #generate tabs
    tab_positions = []
    for i in range(0, tabcount):
        xPos1 = i * 2 * width + offset
        xPos2 = xPos1 + width
        tab_positions.append((xPos1 + startInset, xPos2+startInset))
    
    # top baseline before first tab
    vertical.append(makeTabLine(startInset,0,startInset,-depth))
    horizontal.append(makeTabLine(startInset,-depth,tab_positions[0][0],-depth))
    # bottom
    baseHoles.append(makeTabLine(startInset,0,tab_positions[0][0],0))
    
    # create tab pattern on bottom of wall
    for i, (xPos1, xPos2) in enumerate(tab_positions):
    
        # tab bottom
        horizontal.append(makeTabLine(xPos1,0,xPos2,0))
        
        # hole bottom
        baseHoles.append(makeTabLine(xPos1,-depth,xPos2,-depth))
    
        # left vertical
        vertical.append(makeTabLine(xPos1,-depth,xPos1,0))
        baseHoles.append(makeTabLine(xPos1,-depth,xPos1,0))  
    
        # right vertical
        vertical.append(makeTabLine(xPos2,-depth,xPos2,0))
        baseHoles.append(makeTabLine(xPos2,-depth,xPos2,0))  
    
        # top segment to next tab
        if i < len(tab_positions)-1:
            nextStart = tab_positions[i+1][0]
            horizontal.append(makeTabLine(xPos2,-depth,nextStart,-depth))
            baseHoles.append(makeTabLine(xPos2,0,nextStart,0))  
    
    # top baseline after last tab
    vertical.append(makeTabLine(startInset + usableLength,0,startInset + usableLength,-depth))   
    horizontal.append(makeTabLine(tab_positions[-1][1],-depth,startInset + usableLength,-depth))
    baseHoles.append(makeTabLine(tab_positions[-1][1],0,startInset + usableLength,0))

    
    # transform base holes
    
    # -------------------------
    # TRANSFORM TO SOURCE LINE
    # -------------------------
    
    
    if side:
        start = curve.PointAtStart
        end = curve.PointAtEnd
    else:
        start = curve.PointAtEnd
        end = curve.PointAtStart
    
    xAxis = end - start
    xAxis.Unitize()
    
    yAxis = rg.Vector3d(-xAxis.Y, xAxis.X, 0)
    
    sourcePlane = rg.Plane.WorldXY
    targetPlane = rg.Plane(start, xAxis, yAxis)
    
    xform = rg.Transform.PlaneToPlane(sourcePlane, targetPlane)
    
    for hole in baseHoles:
        hole.Transform(xform)
        placedHoles.append(hole)
    
    # close paths on letter / shape outline
    placedHoles = [ln.ToNurbsCurve() for ln in placedHoles]
    placedHoles = rg.Curve.JoinCurves(placedHoles)
    
    
    #vertical including specials
    if specialLeft and special:
        vertical.extend(makeVerticalTabs(startInset, depth, True, True, False))
    elif prevIsLine:
        vertical.extend(makeVerticalTabs(startInset, tabHeight, True, invertPattern, insideCornerLeft)) #invert pattern for this bit, and not for other bit
    else:
        vertical.append(rg.Line(rg.Point3d(startInset,0,0), rg.Point3d(startInset,height,0)))
    
    if specialRight and special :
        vertical.extend(makeVerticalTabs(startInset+usableLength, depth, False, True, False))
    elif nextIsLine:
        vertical.extend(makeVerticalTabs(startInset+usableLength, tabHeight, False, invertPattern,insideCornerRight))
    else:
        vertical.append(rg.Line(rg.Point3d(startInset+usableLength,0,0), rg.Point3d(startInset+usableLength,height,0)))

else:
    
    #no bottom tabs section, could be curve

    # horizontal lines
    horizontal.append(rg.Line(rg.Point3d(startInset,-depth,0), rg.Point3d(startInset+usableLength, -depth,0)))
    horizontal.append(rg.Line(rg.Point3d(startInset,height,0), rg.Point3d(startInset+usableLength , height,0)))
    
    #do side tabs if we're special
    if specialLeft and special:
        vertical.extend(makeVerticalTabs(startInset, depth, True, True, False))
        vertical.append(rg.Line(rg.Point3d(startInset,-depth,0), rg.Point3d(startInset,0,0)))
    else:
        vertical.append(rg.Line(rg.Point3d(startInset,-depth,0), rg.Point3d(startInset, height,0)))
    
    if specialRight and special :
        vertical.extend(makeVerticalTabs(startInset+usableLength, depth, False, True, False))
        vertical.append(rg.Line(rg.Point3d(startInset+usableLength,-depth,0), rg.Point3d(startInset+usableLength,0,0)))
    else:
        vertical.append(rg.Line(rg.Point3d(startInset+usableLength,-depth,0), rg.Point3d(startInset+usableLength, height,0)))
    
    # place original curve (cut if special)
    placedHoles.append(trimmedCurve)

    if isCurve:
        #do kern bending pattern
        kerf_left = rg.Line(rg.Point3d(startInset,-depth,0), rg.Point3d(startInset+usableLength, -depth,0))
        kerf_bottom = rg.Line(rg.Point3d(startInset,-depth,0), rg.Point3d(startInset, height,0))
# ---------- end make_cut_pattern ----------
panel_2 = Panel(make_cut_pattern.horizontal)

# ----
ghpython_script = GhPythonScript(
    bottom=make_cut_pattern.kerf_bottom,
    left=make_cut_pattern.kerf_left,
    l=Slider(31, range=20..40),
    dis=Slider(8, range=1..30),
    sp=Slider(1.5, range=1..5))  # -> out, pattern; inputs bottom: Line, left: Line
# ---------- ghpython_script: Python ----------
import Rhino.Geometry as rg

if bottom and left: 

    l = float(l)
    dis = float(dis)
    sp = float(sp)
    
    # Set the length of the segment
    L = bottom.Length
    x = (L/(l+dis))
    xint = int(x+0.5)
    d = L/xint-l
    
    L_2 = left.Length
    x_2 = (L_2/sp)
    xint_2 = int(x_2+0.5)
    s = L_2/xint_2
    
    
    #----------Generate pattern A----------#
    joins = []
    a = bottom.From
    joins.append(a)
    
    p = rg.Point3d(a.X, a.Y + (l/2), a.Z)
    joins.append(p)
    
    for i in range(1, xint):
        c = rg.Point3d(p.X, p.Y + d, p.Z)
        joins.append(c)
    
        p = rg.Point3d(c.X, c.Y + l, c.Z)
        joins.append(p)
    
    lj = len(joins)-1
    
    p = rg.Point3d(joins[lj].X, joins[lj].Y + d, joins[lj].Z)
    joins.append(p)
    
    c = rg.Point3d(p.X, p.Y + (l/2), p.Z)
    joins.append(c)
    
    pattern_A = []
    
    for i in range(0, len(joins)-1, 2):
        pattern_A.append(rg.Line(joins[i], joins[i+1]))
    
    
    #----------Generate pattern B----------#
    joins_2 = []
    joins_2.append(a)
    
    p_2 = rg.Point3d(a.X, a.Y+ (d/2), a.Z)
    joins_2.append(p_2)
    
    for i in range(1, xint+1):
        c_2 = rg.Point3d(p_2.X, p_2.Y + l, p_2.Z)
        joins_2.append(c_2)
    
        p_2 = rg.Point3d(c_2.X, c_2.Y + d, c_2.Z)
        joins_2.append(p_2)
    
    pattern_B = []
    
    for i in range(1, len(joins_2)-1, 2):
        pattern_B.append(rg.Line(joins_2[i], joins_2[i+1]))
    
    
    # Move pattern B
    p_B = []
    
    for line in pattern_B:
        p1 = rg.Point3d(line.FromX + s, line.FromY, line.FromZ)
        p2 = rg.Point3d(line.ToX + s, line.ToY, line.ToZ)
        p_B.append(rg.Line(p1, p2))
    
    
    # Copy rows
    all_patterns = []
    all_patterns.extend(pattern_A)
    all_patterns.extend(p_B)
    
    current_A = pattern_A[:]
    current_B = p_B[:]
    
    for i in range(0, xint_2-1, 2):
    
        new_A = []
        for line in current_A:
            p1 = rg.Point3d(line.FromX + s*2, line.FromY, line.FromZ)
            p2 = rg.Point3d(line.ToX + s*2, line.ToY, line.ToZ)
            new_A.append(rg.Line(p1, p2))
    
        new_B = []
        for line in current_B:
            p1 = rg.Point3d(line.FromX + s*2, line.FromY, line.FromZ)
            p2 = rg.Point3d(line.ToX+ s*2, line.ToY , line.ToZ)
            new_B.append(rg.Line(p1, p2))
    
        all_patterns.extend(new_A)
        all_patterns.extend(new_B)
    
        current_A = new_A
        current_B = new_B
    
    
    pattern = all_patterns
# ---------- end ghpython_script ----------
ghpython_script_2 = GhPythonScript(
    inputParts=simplify_tree,
    section=section,
    index=number_slider,
    chainLength=chain_length,
    curveJoinInset=curve_join_inset,
    depth=material_thickness,
    height=height,
    partsSeperation=parts_seperation,
    type=type,
    preserveLength=preserve_length)  # -> out, outputGeometry, baseGeometry, a, debug; inputs inputParts: tree of Curve, section: Int32, index: Int32, chainLength: Int32, type: Int32
# ---------- ghpython_script_2: Python ----------
import Rhino.Geometry as rg
import math

def makeTabLine(x1,y1,x2,y2):
    return rg.Line(
        rg.Point3d(x1,y1,0),
        rg.Point3d(x2,y2,0)
    )

def trimCurveByLength(crv, startDist, endDist):

    total = crv.GetLength()

    t0 = crv.Domain.Min
    t1 = crv.Domain.Max

    success0, startT = crv.LengthParameter(startDist)
    success1, endT = crv.LengthParameter(total - endDist)

    if not success0:
        startT = t0

    if not success1:
        endT = t1

    return crv.Trim(startT, endT)
    
def cornerAngle(a, b):

    ta = a.TangentAt(a.Domain.Max)
    tb = b.TangentAt(b.Domain.Min)

    ta.Unitize()
    tb.Unitize()

    angle = rg.Vector3d.VectorAngle(ta, tb)

    return angle  # radians

def trimMiddleCurvesToLeaveLength(crv, keepStartLength, keepEndLength):

    total = crv.GetLength()

    # --- start piece ---
    successA, tA = crv.LengthParameter(keepStartLength)

    if not successA:
        return None

    startPiece = crv.Trim(crv.Domain.Min, tA)

    # --- end piece ---
    successB, tB = crv.LengthParameter(total - keepEndLength)

    if not successB:
        return None

    endPiece = crv.Trim(tB, crv.Domain.Max)

    # bridge line
    bridge = rg.LineCurve(
        startPiece.PointAtEnd,
        endPiece.PointAtStart
    )

    joined = rg.Curve.JoinCurves([
        startPiece,
        bridge,
        endPiece
    ])

    if not joined or len(joined) == 0:
        return None

    return joined[0]

#Select parts, and get state of it
section = int(section)
branch = inputParts.Branch(section)
#index = int(index) % len(branch)
index = int(index)
count = len(branch)
if not curveJoinInset:
    curveJoinInset = 10.0

pieces = []

startCurve = branch[index % count]
endCurve = branch[(index + (chainLength-1)) % count]

startCurveLength = startCurve.GetLength()
endCurveLength = endCurve.GetLength()

for i in range(chainLength):
    pieces.append(branch[(index + i) % count])
    

#join pieces together
joined = rg.Curve.JoinCurves(pieces)[0]

# trim by join inset
innerFull = trimCurveByLength(joined,startCurveLength - curveJoinInset,endCurveLength - curveJoinInset)
baseGeometry = innerFull
#debug=innerFull
innerCut = trimCurveByLength(joined,startCurveLength - curveJoinInset + depth, endCurveLength - curveJoinInset + depth )
#debug=innerCut

shortenedFull = trimMiddleCurvesToLeaveLength(
    innerFull,
    preserveLength,
    preserveLength
)
shortenedCut = trimMiddleCurvesToLeaveLength(
    innerCut,
    preserveLength,
    preserveLength
)
# offset chooses to keep only the longer part of the joined curve
#debug=joinedBits.Offset( rg.Plane.WorldXY,-depth, 0.01, rg.CurveOffsetCornerStyle.Sharp)
#debug=innerFull.Offset( rg.Plane.WorldXY,-depth, 0.01, rg.CurveOffsetCornerStyle.Sharp)

#create offsets
offsetFull = rg.Curve.JoinCurves(shortenedFull.Offset( rg.Plane.WorldXY,-depth, 0.01, rg.CurveOffsetCornerStyle.Sharp))[0]
offsetCut = rg.Curve.JoinCurves(shortenedCut.Offset( rg.Plane.WorldXY,-depth, 0.01, rg.CurveOffsetCornerStyle.Sharp))[0]
#debug = []
#debug.append(offsetFull)
#debug.append(offsetCut)
#debug.append(innerCut)
#debug.append(innerFull)




fullSet = []
fullSet.append(innerFull)
fullSet.append(offsetFull)
fullSet.append(rg.LineCurve(innerFull.PointAtStart, offsetFull.PointAtStart))
fullSet.append(rg.LineCurve(innerFull.PointAtEnd, offsetFull.PointAtEnd))

fullJoined = rg.Curve.JoinCurves(fullSet)[0]

cutSet = []
cutSet.append(innerCut)
cutSet.append(offsetCut)
cutSet.append(rg.LineCurve(innerCut.PointAtStart, offsetCut.PointAtStart ))
cutSet.append(rg.LineCurve(innerCut.PointAtEnd, offsetCut.PointAtEnd ))
cutJoined = rg.Curve.JoinCurves(cutSet)[0]


layerPatterns = [] 
layerPatterns.append(fullJoined)
layerPatterns.append(cutJoined)

layerCount = int((height + depth)/ depth)



outputGeometry = []

# where to draw the parts
bbox = offsetFull.GetBoundingBox(True)
current_location = bbox.Center
origin = rg.Point3d(0, 0, 0)
move_vector = origin - current_location

bbox_width = bbox.Max.X - bbox.Min.X
if type == 1:
    for layer in range(layerCount):
        #for part in layerPatterns[layer % 2]:
        #    part_copy = part.Duplicate()
        #    part_copy.Transform(rg.Transform.Translation(move_vector + rg.Vector3d(bbox_width * layer* partsSeperation, 0, 0)))
        #    outputGeometry.append(part_copy)
        layer_copy = layerPatterns[layer % 2].Duplicate()
        layer_copy.Transform(rg.Transform.Translation(move_vector + rg.Vector3d(bbox_width * layer* partsSeperation, 0, 0)))
        outputGeometry.append(layer_copy)


#3d print part
if type == 2:
    printParts = []
    fullBrep = rg.Brep.CreatePlanarBreps(fullJoined)[0]
    cutBrep = rg.Brep.CreatePlanarBreps(cutJoined)[0]
    thickness = depth
    path = rg.LineCurve(
        rg.Point3d(0,0,0),
        rg.Point3d(0,0,thickness)
    )
    extrusionVec = rg.Vector3d(0,0,thickness)
    fullSolid = fullBrep.Faces[0].CreateExtrusion(
        path,
        True
    )
    cutSolid = cutBrep.Faces[0].CreateExtrusion(
        path,
        True
    )
    layerPatterns = [fullSolid, cutSolid]
    for layer in range(layerCount):

        solid = layerPatterns[layer % 2].DuplicateBrep()
        xform = rg.Transform.Translation(
            move_vector +
            rg.Vector3d(
                0,
                0,
                layer * depth
            )
        )
        solid.Transform(xform)
        printParts.append(solid)
    #outputGeometry = printParts
    #a = rg.Brep.CreateBooleanUnion(printParts, 0.01)
    a = rg.Brep.JoinBreps(printParts, 0.01)
# ---------- end ghpython_script_2 ----------
panel_3 = Panel(make_cut_pattern.out)
panel_4 = Panel(ghpython_script_2.out)
panel_5 = Panel(ghpython_script_2.a)
merge = Merge(
    Data1=make_cut_pattern.horizontal,
    Data2=make_cut_pattern.vertical,
    Data3=make_cut_pattern.placedHoles,
    Data4=ghpython_script.pattern)
merge_2 = Merge(Data1=ghpython_script_2.debug)
